vi "BPSK_Tx_Rx_Template.gvi"   [LabVIEW Communications System Design Suite 2.0.1]
panel controls:
  "IQ rate": f64 = 200000
  "device names": "niUSRPClass"
  "carrier frequency": f64 = 400000000
  "gain Tx": f64
  "active antenna Tx": string = "TX1"
  "stop Tx": bool
  "gain Rx": f64
  "active antenna Rx": string = "RX2"
  "total bits": i32 = 128
panel indicators:
  "Baseband Waveform": waveform<f64>
  "Baseband Power Spectrum": T1
  "Baseband Output": cluster{"t0": f64, "dt": f64, "Y": f64[]}
types:
  T1 = cluster{"f0": f64, "df": f64, "magnitude": f64[]}
uses:
  NI::Analysis::Resampling::Upsample (CDB).gvi
diagram:
  Random Number() -> (number (0 to 1)=w1)
  # No random number if need to debug
  call "MT Generate Bits (Fibonacci, PN Order).gvi"(total bits=$"total bits", seed in=w1) -> (output bit stream=w2)
  call "MT Map Bits to PSK Symbols.gvi"(input bit stream=w2, symbol map=[-1, 1]) -> (symbols=w3)
  call "AddFrameHeader (complex).gvi"(array=w3) -> (output array=w4)
  call "Upsample (CDB).gvi"(input array=w4)
  Build Waveform Node() -> (output waveform=w5)
  $"Baseband Waveform" <- w5
  w6 = cluster{"t0": f64, "dt": f64, "Y": f64[]} {all zero or empty}
  Property Node(instance in=w6) -> (instance out=w7)  # Cluster Properties
  $"Baseband Output" <- w7
  w8 = cluster{"t0": timestamp, "dt": f64, "Y": c128[]} {all zero or empty}
  Property Node(instance in=w8) -> (instance out=w9)
  call "FFT Power Spectrum for 1 Chan (CDB)2.gvi"(time signal=w9, dB On (F)=TRUE) -> (power spectrum=w10)
  $"Baseband Power Spectrum" <- w10
  call "niUSRP Open Rx Session.gvi"(device names=$"device names") -> (error out=w11, session handle out=w12)
  call "niUSRP Configure Signal.gvi"(session handle=w12, IQ rate=$"IQ rate", carrier frequency=$"carrier frequency", gain=$"gain Rx", error in=w11, active antenna=$"active antenna Rx") -> (session handle out=w13, coerced carrier frequency=w14, error out=w15)
  Subtract(x=w14, y=20000) -> w16
  Property Node(instance in=w13, "LO Frequency"=w16) -> (instance out=w17)
  call "niUSRP Initiate.gvi"(session handle=w17, error in=w15) -> (session handle out=w18, error out=w19)
  call "niUSRP Fetch Rx Data (CDB).gvi"(session handle=w18, number of samples=1000000, error in=w19) -> (session handle out=w20, error out=w21)
  call "niUSRP Close Session.gvi"(session handle=w20, error in=w21)
  call "niUSRP Open Tx Session.gvi"(device names=$"device names") -> (session handle out=w22, error out=w23)
  call "niUSRP Configure Signal.gvi"(session handle=w22, IQ rate=$"IQ rate", carrier frequency=$"carrier frequency", gain=$"gain Tx", error in=w23, active antenna=$"active antenna Tx") -> (session handle out=w24, error out=w25)
  while {
    call "niUSRP Write Tx Data (CDB).gvi"(session handle=w24, error in=w25) -> (session handle out=w26, error out=w27)
    stop if $"stop Tx"
  }
  call "niUSRP Close Session.gvi"(session handle=w26, error in=w27)
