vi "CLT.gvi"   [LabVIEW Communications System Design Suite 2.0.1]
panel controls:
  "milliseconds to wait": u32
  "number of bins": i32 = 10
panel indicators:
  "Count": i32
  "histogram": T1
types:
  T1 = cluster{"x values": f64[], "histogram h(x)": f64[]}
uses:
  NI::Analysis::Statistics::Statistics (1D DBL).gvi
  NI::Analysis::Statistics::Histogram (single-shot)(DBL Array).gvi
diagram:
  w1 = 10000  # Product of Nested For Loops
  w2 = $"number of bins"
  w3 = $"milliseconds to wait"
  s1 = f64[] []  # shift register
  while (iteration -> i1) {
    Wait(time to wait=w3)
    Is Greater Or Equal(x=i1, y=10000) -> w4
    $Count <- i1
    s2 = f64[][] []  # shift register
    for (N = 100) {
      s3 = f64[] []  # shift register
      for (N = 100) {
        Random Number() -> (number (0 to 1)=w5)
        Build Array[ConcatenateInputs=True](s3, w5) -> w6
        next s3 = w6
      }
      Build Array[ConcatenateInputs=True](s2, s3) -> w7
      next s2 = w7
    }
    Add Array Elements(numeric array=s2) -> (sum=w8)
    Divide(x=w8, y=w1) -> w9
    Insert Into Array(inArray=s1, index0=i1, new=w9) -> w10
    call "Statistics (1D DBL).gvi"(signal=w10) -> (mean=w11, variance=w12)
    Subtract(x=w10, y=w11) -> w13
    Divide(x=w13, y=w12) -> w14
    call "Histogram (single-shot)(DBL Array).gvi"(signal=w14, number of bins=w2) -> (histogram=w15)
    $histogram <- w15
    next s1 = w10
    stop if w4
  }
