vi "AM Coherent.gvi"   [LabVIEW Communications System Design Suite 2.0.1]
inputs:
  "AM signal": waveform<f64> = {dt=1, Y=[]}
  "Carrier": waveform<f64> = {dt=1, Y=[]}
  "order": i32 = 2
  "cutoff frequency": f64 = 0.125
outputs:
  "Message Sig": waveform<f64>
  "Message Signal Frequency domains": T1
types:
  T1 = cluster{"f0": f64, "df": f64, "magnitude": f64[]}
uses:
  NI::Analysis::Filtering::Butterworth Lowpass Filter (Waveform).gvi
  NI::Analysis::Measurement::AC DC and RMS (single-shot)(Wfm).gvi
  NI::Analysis::Measurement::Power Spectral Density for 1 Chan.gvi
diagram:
  Waveform Multiply($"AM signal", $Carrier) -> w1
  call "Butterworth Lowpass Filter (Waveform).gvi"(signal=w1, cutoff frequency=$"cutoff frequency", order=$order) -> (filtered signal=w2)
  call "AC DC and RMS (single-shot)(Wfm).gvi"(signal=w2) -> (DC value=w3)
  Waveform Subtract(x=w2, y=w3) -> w4
  call "Power Spectral Density for 1 Chan.gvi"(signal=w4) -> (power spectral density=w5)
  $"Message Signal Frequency domains" <- w5
  $"Message Sig" <- w4
