vi "AM.gvi"   [LabVIEW Communications System Design Suite 2.0.1]
inputs:
  "\"1kHz\" Message frequency": f64 = 10
  "Message amplitude": f64 = 1
  "\"10kHZ\"Carrier frequency": f64 = 10
  "Carrier amplitude": f64 = 1
  "Carrier sample rate": f64 = 1000
  "Carrier samples": i32 = 1000
  "message sample rate": f64 = 1000
  "message samples": i32 = 1000
outputs:
  "message signal": waveform<f64>
  "carrier signal": waveform<f64>
  "AM": waveform<f64>
  "psd of message signal": T1
  "psd of carrier signal": T1
  "PSD of AM": T1
types:
  T1 = cluster{"f0": f64, "df": f64, "magnitude": f64[]}
uses:
  NI::Analysis::Generation::Sine Waveform.gvi
  NI::Analysis::Measurement::Power Spectral Density for 1 Chan.gvi
diagram:
  # 90 degrees??????
  call "Sine Waveform.gvi"(amplitude=$"Carrier amplitude", frequency=$"\"10kHZ\"Carrier frequency", phase in=90, sample rate=$"Carrier sample rate", samples=$"Carrier samples") -> (sine wave=w1)
  call "Power Spectral Density for 1 Chan.gvi"(signal=w1) -> (power spectral density=w2)
  $"psd of carrier signal" <- w2
  $"carrier signal" <- w1
  call "Sine Waveform.gvi"(amplitude=$"Message amplitude", frequency=$"\"1kHz\" Message frequency", phase in=90, sample rate=$"message sample rate", samples=$"message samples") -> (sine wave=w3)
  call "Power Spectral Density for 1 Chan.gvi"(signal=w3) -> (power spectral density=w4)
  $"psd of message signal" <- w4
  Waveform Multiply($"Message amplitude", w3) -> w5
  Waveform Add($"Carrier amplitude", w5) -> w6
  Waveform Multiply(w1, w6) -> w7
  call "Power Spectral Density for 1 Chan.gvi"(signal=w7) -> (power spectral density=w8)
  $"PSD of AM" <- w8
  $AM <- w7
  $"message signal" <- w3
