vi "AMEnvelopeDetection.gvi"   [LabVIEW Communications System Design Suite 2.0.1]
inputs:
  "AM modulated signal": waveform<f64> = {dt=1, Y=[]}
  "order": i32 = 2
  "cutoff frequency": f64 = 0.125
outputs:
  "Message Sig": waveform<f64>
  "Message Signal Frequency domains": T1
  "error?": bool  # error? returns TRUE if an error occurs. If this VI finds an error, it sets the parameters in the error cluster.
types:
  T1 = cluster{"f0": f64, "df": f64, "magnitude": f64[]}
uses:
  NI::Analysis::Filtering::Butterworth Lowpass Filter (Waveform).gvi
  NI::Analysis::Measurement::AC DC and RMS (single-shot)(Wfm).gvi
  NI::Analysis::Measurement::Power Spectral Density for 1 Chan.gvi
diagram:
  Waveform Multiply($"AM modulated signal", Pi) -> (error out=w1, o=w2)
  Property Node(instance in=w2) -> ("Y"=w3, "t0"=w4, "dt"=w5, "attributes"=w6)
  for {
    w7 = each element of w3
    Is Greater(x=w7, y=0) -> w9
    Select(s=w9, t=w7, f=0) -> w10
    append w10 to w8
  }
  Build Waveform Node(Y=w8, attributes=w6, dt=w5, t0=w4) -> (output waveform=w11)
  call "Butterworth Lowpass Filter (Waveform).gvi"(signal=w11, cutoff frequency=$"cutoff frequency", error in=w1, order=$order) -> (filtered signal=w12, error out=w13)
  call "AC DC and RMS (single-shot)(Wfm).gvi"(signal=w12, error in=w13) -> (error out=w14, DC value=w15)
  Waveform Subtract(error in=w14, x=w12, y=w15) -> (error out=w16, x-y=w17)
  call "Power Spectral Density for 1 Chan.gvi"(signal=w17, error in=w16) -> (power spectral density=w18, error out=w19)
  $"Message Signal Frequency domains" <- w18
  call "Display Error.gvi"(error in=w19) -> (error?=w20)
  $"error?" <- w20
  $"Message Sig" <- w17
