vi "AMTopLevel.gvi"   [LabVIEW Communications System Design Suite 2.0.1]
panel controls:
  "\"1kHz\" Message frequency": f64 = 10
  "Message amplitude": f64 = 1
  "\"10kHZ\"Carrier frequency": f64 = 10
  "Carrier amplitude": f64 = 1
  "message sample rate": f64 = 1000
  "Carrier samples": i32 = 1000
  "cutoff frequency": f64 = 0.125
  "order": i32 = 2
  "stop": bool
panel indicators:
  "Message Signal Coherent Demudulation": waveform<f64>
  "Message Signal Envelope detection": waveform<f64>
  "AM": waveform<f64>
diagram:
  while {
    call "AM.gvi"("1kHz" Message frequency=$"\"1kHz\" Message frequency", Message amplitude=$"Message amplitude", "10kHZ"Carrier frequency=$"\"10kHZ\"Carrier frequency", Carrier amplitude=$"Carrier amplitude", Carrier sample rate=$"message sample rate", Carrier samples=$"Carrier samples", message sample rate=$"message sample rate", message samples=$"Carrier samples") -> (carrier signal=w1, AM=w2)
    $AM <- w2
    call "AM Coherent.gvi"(AM signal=w2, Carrier=w1, order=$order, cutoff frequency=$"cutoff frequency") -> (Message Sig=w3)
    $"Message Signal Coherent Demudulation" <- w3
    call "AMEnvelopeDetection.gvi"(AM modulated signal=w2, order=$order, cutoff frequency=$"cutoff frequency") -> (Message Sig=w4)
    $"Message Signal Envelope detection" <- w4
    stop if $stop
  }
