vi "FMDemodulator.gvi"   [LabVIEW Communications System Design Suite 2.0.1]
inputs:
  "waveform in": waveform<f64> = {dt=1, Y=[]}
  "order": i32 = 2
  "cutoff frequency": f64 = 0.125
outputs:
  "Wave Out": waveform<f64>
  "PSD out": T1
  "error?": bool  # error? returns TRUE if an error occurs. If this VI finds an error, it sets the parameters in the error cluster.
types:
  T1 = cluster{"f0": f64, "df": f64, "magnitude": f64[]}
uses:
  NI::Analysis::IntegralDifferentiation::Derivative x(t).gvi
diagram:
  Property Node(instance in=$"waveform in") -> ("Y"=w1, "t0"=w2, "dt"=w3, "attributes"=w4)
  call "Derivative x(t).gvi"(x(t)=w1, dt=w3) -> (dx(t)/dt=w5)
  Build Waveform Node(Y=w5, attributes=w4, dt=w3, t0=w2) -> (output waveform=w6)
  call "AMEnvelopeDetection.gvi"(AM modulated signal=w6, order=$order, cutoff frequency=$"cutoff frequency") -> (Message Sig=w7, Message Signal Frequency domains=w8, error?=w9)
  Waveform Divide(x=w7, y=20000) -> w10
  $"Wave Out" <- w10
  $"PSD out" <- w8
  $"error?" <- w9
