vi "FMTopLevel.gvi"   [LabVIEW Communications System Design Suite 2.0.1]
panel controls:
  "sample rate": f64 = 1000
  "samples": i32 = 1000
  "delta f": f64
  "message frequency": f64 = 10
  "message amplitude": f64 = 1
  "carrier amplitude": f64 = 1
  "carrier frequency": f64 = 10
  "order": i32 = 2
  "cutoff frequency": f64 = 0.125
panel indicators:
  "Message Sig": waveform<f64>
  "FM signal": waveform<f64>
  "Demodulated Signal": waveform<f64>
  "Demodulated PSD": T1
types:
  T1 = cluster{"f0": f64, "df": f64, "magnitude": f64[]}
diagram:
  call "FM_Mudulator.gvi"(sample rate=$"sample rate", samples=$samples, message frequency=$"message frequency", message amplitude=$"message amplitude", carrier amplitude=$"carrier amplitude", carrier frequency=$"carrier frequency", delta f=$"delta f") -> (message signal=w1, fm=w2)
  $"FM signal" <- w2
  $"Message Sig" <- w1
  call "FMDemodulator.gvi"(waveform in=w2, order=$order, cutoff frequency=$"cutoff frequency") -> (Wave Out=w3, PSD out=w4)
  $"Demodulated Signal" <- w3
  $"Demodulated PSD" <- w4
