vi "FM_Mudulator.gvi"   [LabVIEW Communications System Design Suite 2.0.1]
inputs:
  "sample rate": f64 = 1000
  "samples": i32 = 1000
  "message frequency": f64 = 10
  "message amplitude": f64 = 1
  "carrier amplitude": f64 = 1
  "carrier frequency": f64 = 10
  "delta f": f64
outputs:
  "message signal": waveform<f64>
  "fm": waveform<f64>
  "PSD of FM": T1
  "dMessage": f64[]
types:
  T1 = cluster{"f0": f64, "df": f64, "magnitude": f64[]}
uses:
  NI::Analysis::Generation::Sine Waveform.gvi
  NI::Analysis::IntegralDifferentiation::Integral x(t).gvi
  NI::Analysis::IntegralDifferentiation::Derivative x(t).gvi
  NI::Analysis::Measurement::Power Spectral Density for 1 Chan.gvi
diagram:
  call "Sine Waveform.gvi"(amplitude=$"message amplitude", frequency=$"message frequency", sample rate=$"sample rate", samples=$samples) -> (sine wave=w1)
  Property Node(instance in=w1) -> ("Y"=w2, "t0"=w3, "dt"=w4, "attributes"=w5)
  call "Integral x(t).gvi"(x(t)=w2, dt=w4) -> (integral x(t)=w6)
  Multiply($"delta f", PiTimes2) -> w7
  Multiply(w7, w6) -> w8
  call "Derivative x(t).gvi"(x(t)=w8, dt=w4) -> (dx(t)/dt=w9)
  $dMessage <- w9
  $"message signal" <- w1
  call "Sine Waveform.gvi"(amplitude=$"carrier amplitude", frequency=$"carrier frequency", sample rate=$"sample rate", samples=$samples) -> (sine wave=w10)
  Sine And Cosine(x=w8) -> (cos(x)=w11, sin(x)=w12)
  Build Waveform Node(Y=w12, attributes=w5, dt=w4, t0=w3) -> (output waveform=w13)
  Waveform Multiply(w13, w10) -> w14
  call "Sine Waveform.gvi"(amplitude=$"carrier amplitude", frequency=$"carrier frequency", phase in=90, sample rate=$"sample rate", samples=$samples) -> (sine wave=w15)
  Build Waveform Node(Y=w11, attributes=w5, dt=w4, t0=w3) -> (output waveform=w16)
  Waveform Multiply(w16, w15) -> w17
  Waveform Subtract(x=w14, y=w17) -> w18
  call "Power Spectral Density for 1 Chan.gvi"(signal=w18) -> (power spectral density=w19)
  $"PSD of FM" <- w19
  $fm <- w18
