vi "BER.gvi"   [LabVIEW Communications System Design Suite 2.0.1]
inputs:
  "transmitted bits": i8[]
  "received bits": i16[]
outputs:
  "BER": f64
panel controls:
  "error in": error
panel indicators:
  "error out": error
diagram:
  Array Size(array=$"received bits") -> (size(s)=w1)
  C Code Node("received_bits"=$"received bits", "transmitted_bits"=$"transmitted bits", "length"=w1, Error In=$"error in") -> ("BER"=w2, Error Out=w3)
  ~~~
  int i;
  int count=0;
  for(i=0; i<length; i++){
      if(received_bits[i]!=transmitted_bits[i]){
          count++;
      }
  }
  BER=count/length;
  ~~~
  $"error out" <- w3
  $BER <- w2
