vi "BPSK_FEC.gvi"   [LabVIEW Communications System Design Suite 2.0.1]
panel controls:
  "IQ rate": f64 = 200000
  "device names": "niUSRPClass"
  "carrier frequency": f64 = 400000000
  "gain Tx": f64
  "active antenna Tx": string = "TX1"
  "stop Tx": bool
  "gain Rx": f64
  "active antenna Rx": string = "RX2"
  "total bits": i32 = 128
  "symbol rate": f64
panel indicators:
  "Baseband Waveform": waveform<f64>
  "Baseband Power Spectrum": T1
  "input bit stream": i8[]
  "NEW_BER": f64
types:
  T1 = cluster{"f0": f64, "df": f64, "magnitude": f64[]}
uses:
  NI::Analysis::Operations::1D Convolution (DBL).gvi
  NI::Analysis::Resampling::Decimate (single shot, CDB).gvi
  NI::Analysis::Resampling::Upsample (DBL).gvi
diagram:
  call "MT Generate Bits (Fibonacci, PN Order).gvi"(total bits=$"total bits") -> (output bit stream=w1)
  $"input bit stream" <- w1
  Build Array[ConcatenateInputs=True](w1, w1, w1) -> w2
  Divide(x=$"IQ rate", y=$"symbol rate") -> w3
  call "MT Generate Filter Coefficients.gvi"(pulse shaping filter="Root Raised Cos", matched samples per symbol=w3, modulation type="PSK") -> (matched filter coefficients=w4)
  call "niUSRP Open Rx Session.gvi"(device names=$"device names") -> (error out=w5, session handle out=w6)
  call "niUSRP Configure Signal.gvi"(session handle=w6, IQ rate=$"IQ rate", carrier frequency=$"carrier frequency", gain=$"gain Rx", error in=w5, active antenna=$"active antenna Rx") -> (session handle out=w7, coerced carrier frequency=w8, error out=w9)
  Subtract(x=w8, y=20000) -> w10
  Property Node(instance in=w7, "LO Frequency"=w10) -> (instance out=w11)
  call "niUSRP Initiate.gvi"(session handle=w11, error in=w9) -> (session handle out=w12, error out=w13)
  call "niUSRP Fetch Rx Data (CDB).gvi"(session handle=w12, number of samples=1000000, error in=w13) -> (session handle out=w14, data=w15, error out=w16)
  call "FrameSync.gvi"(Sampled Input=w15) -> (Aligned Samples=w17)
  call "Channel Estimator.gvi"(input signal=w17) -> (signal out=w18)
  Complex To Real Imaginary(x + iy=w18) -> (x=w19)
  call "1D Convolution (DBL).gvi"(x=w19, y=w4) -> (x * y=w20)
  call "PulseAlign.gvi"(Input signal=w20, Receiver Sampling Factor=w3) -> (aligned output=w21)
  call "Decimate (single shot, CDB).gvi"(input array=w21, decimating factor=w3) -> (decimated array=w22)
  call "FrameSync.gvi"(Sampled Input=w22) -> (Aligned Samples=w23)
  Complex To Real Imaginary(x + iy=w23) -> (x=w24)
  Is Greater Than 0(x=w24) -> w25
  Boolean To Integer(Boolean=w25) -> (0, 1=w26)
  Multiply($"total bits", 3) -> w27
  Array Subset(array=w26, index0=0, length0=w27) -> w28
  call "FEC Decoder.gvi"(data_in=w28) -> (output=w29)
  call "BER.gvi"(transmitted bits=w2, received bits=w29) -> (BER=w30)
  $NEW_BER <- w30
  Reciprocal(x=$"IQ rate") -> w31
  w32 = cluster{"t0": timestamp, "dt": f64, "Y": c128[]} {all zero or empty}
  Property Node(instance in=w32, "dt"=w31, "Y"=w20) -> (instance out=w33)
  call "FFT Power Spectrum for 1 Chan (CDB)2.gvi"(time signal=w33, dB On (F)=TRUE) -> (power spectrum=w34)
  $"Baseband Power Spectrum" <- w34
  Multiply(w2, 2) -> w35
  Subtract(x=w35, y=1) -> w36
  call "AddFrameHeader.gvi"(array=w36) -> (output array=w37)
  call "Upsample (DBL).gvi"(input array=w37, upsampling factor=20) -> (upsampled array=w38)
  call "MT Generate Filter Coefficients.gvi"(pulse shaping filter="none", pulse shaping samples per symbol=w3, modulation type="PSK") -> (pulse shaping filter coefficients=w39)
  call "1D Convolution (DBL).gvi"(x=w38, y=w39) -> (x * y=w40)
  call "Quick Scale 1D.gvi"(X=w40) -> (Y[i]=X[i]/Max|X|=w41)
  Build Waveform Node(Y=w41, dt=w31) -> (output waveform=w42)
  $"Baseband Waveform" <- w42
  call "niUSRP Close Session.gvi"(session handle=w14, error in=w16)
  To Double Precision Complex(number=w41) -> w43
  call "Insert Pilots.gvi"(signal input=w43) -> (output signal=w44)
  call "AddFrameHeader (complex).gvi"(array=w44) -> (output array=w45)
  call "niUSRP Open Tx Session.gvi"(device names=$"device names") -> (session handle out=w46, error out=w47)
  call "niUSRP Configure Signal.gvi"(session handle=w46, IQ rate=$"IQ rate", carrier frequency=$"carrier frequency", gain=$"gain Tx", error in=w47, active antenna=$"active antenna Tx") -> (session handle out=w48, error out=w49)
  while {
    call "niUSRP Write Tx Data (CDB).gvi"(session handle=w48, data=w45, error in=w49) -> (session handle out=w50, error out=w51)
    stop if $"stop Tx"
  }
  call "niUSRP Close Session.gvi"(session handle=w50, error in=w51)
