vi "BPSK_FEC_Try2.gvi"   [LabVIEW Communications System Design Suite 2.0.1]
panel controls:
  "IQ rate": f64 = 200000
  "device names": "niUSRPClass"
  "carrier frequency": f64 = 400000000
  "gain Tx": f64
  "active antenna Tx": string = "TX1"
  "stop Tx": bool
  "gain Rx": f64
  "active antenna Rx": string = "RX2"
  "total bits": i32 = 128
  "symbol rate": f64
  "total bits_2": i32
panel indicators:
  "Baseband Waveform": waveform<f64>
  "Baseband Power Spectrum": T1
  "Baseband output Power Spectrum": T1
  "Baseband Output": waveform<f64>
  "Ouput Bit Stream": i16[]
  "Input Bit Stream": i8[]
  "loop count": f64
  "NEW BER": f64
types:
  T1 = cluster{"f0": f64, "df": f64, "magnitude": f64[]}
uses:
  NI::Analysis::Operations::1D Convolution (DBL).gvi
  NI::Analysis::Resampling::Upsample (DBL).gvi
  NI::Analysis::Resampling::Decimate (single shot, CDB).gvi
diagram:
  Reciprocal(x=$"IQ rate") -> w1
  Divide(x=$"IQ rate", y=$"symbol rate") -> w2
  call "MT Generate Filter Coefficients.gvi"(pulse shaping filter="Root Raised Cos", matched samples per symbol=w2, modulation type="PSK") -> (matched filter coefficients=w3)
  call "niUSRP Open Rx Session.gvi"(device names=$"device names") -> (error out=w4, session handle out=w5)
  call "niUSRP Configure Signal.gvi"(session handle=w5, IQ rate=$"IQ rate", carrier frequency=$"carrier frequency", gain=$"gain Rx", error in=w4, active antenna=$"active antenna Rx") -> (session handle out=w6, coerced carrier frequency=w7, error out=w8)
  Subtract(x=w7, y=20000) -> w9
  Property Node(instance in=w6, "LO Frequency"=w9) -> (instance out=w10)
  call "niUSRP Initiate.gvi"(session handle=w10, error in=w8) -> (session handle out=w11, error out=w12)
  call "niUSRP Fetch Rx Data (CDB).gvi"(session handle=w11, number of samples=1000000, error in=w12) -> (session handle out=w13, data=w14, error out=w15)
  call "FrameSync.gvi"(Sampled Input=w14) -> (Aligned Samples=w16)
  call "Channel Estimator.gvi"(input signal=w16) -> (signal out=w17)
  Complex To Real Imaginary(x + iy=w17) -> (x=w18)
  call "1D Convolution (DBL).gvi"(x=w18, y=w3) -> (x * y=w19)
  w20 = cluster{"t0": timestamp, "dt": f64, "Y": c128[]} {all zero or empty}
  Property Node(instance in=w20, "dt"=w1, "Y"=w19) -> (instance out=w21)
  call "FFT Power Spectrum for 1 Chan (CDB)2.gvi"(time signal=w21, dB On (F)=TRUE) -> (power spectrum=w22)
  $"Baseband output Power Spectrum" <- w22
  call "MT Generate Bits (Fibonacci, PN Order).gvi"(total bits=$"total bits") -> (output bit stream=w23)
  Build Array[ConcatenateInputs=True](w23, w23, w23) -> w24
  Multiply(2, w24) -> w25
  Subtract(x=w25, y=1) -> w26
  call "AddFrameHeader.gvi"(array=w26) -> (output array=w27)
  call "Upsample (DBL).gvi"(input array=w27, upsampling factor=w2) -> (upsampled array=w28)
  call "MT Generate Filter Coefficients.gvi"(pulse shaping filter="Root Raised Cos", pulse shaping samples per symbol=w2, modulation type="PSK") -> (pulse shaping filter coefficients=w29)
  call "1D Convolution (DBL).gvi"(x=w28, y=w29) -> (x * y=w30)
  call "Quick Scale 1D.gvi"(X=w30) -> (Y[i]=X[i]/Max|X|=w31)
  Build Waveform Node(Y=w31, dt=w1) -> (output waveform=w32)
  $"Baseband Waveform" <- w32
  w33 = cluster{"t0": timestamp, "dt": f64, "Y": c128[]} {all zero or empty}
  Property Node(instance in=w33, "dt"=w1, "Y"=w31) -> (instance out=w34)
  call "FFT Power Spectrum for 1 Chan (CDB)2.gvi"(time signal=w34, dB On (F)=TRUE) -> (power spectrum=w35)
  $"Baseband Power Spectrum" <- w35
  $"Input Bit Stream" <- w23
  Build Waveform Node(Y=w19, dt=w1) -> (output waveform=w36)
  $"Baseband Output" <- w36
  call "PulseAlign.gvi"(Input signal=w19, Receiver Sampling Factor=w2) -> (aligned output=w37)
  call "Decimate (single shot, CDB).gvi"(input array=w37) -> (decimated array=w38)
  call "FrameSync.gvi"(Sampled Input=w38) -> (Aligned Samples=w39)
  Complex To Real Imaginary(x + iy=w39) -> (x=w40)
  Is Greater Than 0(x=w40) -> w41
  Boolean To Integer(Boolean=w41) -> (0, 1=w42)
  Multiply(3, $"total bits_2") -> w43
  # should be same as total bit but use control to simplif the graph
  Array Subset(array=w42, index0=0, length0=w43) -> w44
  call "FEC Decoder.gvi"(data_in=w44) -> (output=w45)
  $"Ouput Bit Stream" <- w45
  call "niUSRP Close Session.gvi"(session handle=w13, error in=w15)
  s1 = 0  # shift register
  for {
    w46 = each element of w23
    w47 = each element of w45
    Is Equal(x=w47, y=w46) -> w48
    Select(s=w48, t=0, f=1) -> w49
    Add(s1, w49) -> w50
    next s1 = w50
  }
  Divide(x=s1, y=$"total bits_2") -> w51
  $"NEW BER" <- w51
  $"loop count" <- s1
  call "niUSRP Open Tx Session.gvi"(device names=$"device names") -> (session handle out=w52, error out=w53)
  call "niUSRP Configure Signal.gvi"(session handle=w52, IQ rate=$"IQ rate", carrier frequency=$"carrier frequency", gain=$"gain Tx", error in=w53, active antenna=$"active antenna Tx") -> (session handle out=w54, error out=w55)
  To Double Precision Complex(number=w31) -> w56
  call "Insert Pilots.gvi"(signal input=w56) -> (output signal=w57)
  call "AddFrameHeader (complex).gvi"(array=w57) -> (output array=w58)
  while {
    call "niUSRP Write Tx Data (CDB).gvi"(session handle=w54, data=w58, error in=w55) -> (session handle out=w59, error out=w60)
    stop if $"stop Tx"
  }
  call "niUSRP Close Session.gvi"(session handle=w59, error in=w60)
