vi "BPSK_TX_RX - Copy - Copy.gvi"   [LabVIEW Communications System Design Suite 2.0.1]
panel controls:
  "IQ rate": f64 = 200000
  "device names": "niUSRPClass"
  "carrier frequency": f64 = 400000000
  "gain Tx": f64
  "active antenna Tx": string = "TX1"
  "stop Tx": bool
  "gain Rx": f64
  "active antenna Rx": string = "RX2"
  "total bits": i32 = 128
  "symbol rate": f64
  "total bits_2": i32
panel indicators:
  "Baseband Waveform": waveform<f64>
  "Baseband Power Spectrum": T1
  "Baseband output Power Spectrum": T1
  "Baseband Output": waveform<f64>
  "Ouput Bit Stream": i16[]
  "BER": f64
  "trigger found?": bool
  "Input Bit Stream": f64[]
types:
  T1 = cluster{"f0": f64, "df": f64, "magnitude": f64[]}
uses:
  NI::Analysis::Operations::1D Convolution (DBL).gvi
  NI::Analysis::Resampling::Upsample (DBL).gvi
  NI::Analysis::Resampling::Decimate (single shot, CDB).gvi
diagram:
  Reciprocal(x=$"IQ rate") -> w1
  Divide(x=$"IQ rate", y=$"symbol rate") -> w2
  call "MT Generate Filter Coefficients.gvi"(pulse shaping filter="Root Raised Cos", matched samples per symbol=w2, modulation type="PSK") -> (matched filter coefficients=w3)
  call "niUSRP Open Rx Session.gvi"(device names=$"device names") -> (error out=w4, session handle out=w5)
  call "niUSRP Configure Signal.gvi"(session handle=w5, IQ rate=$"IQ rate", carrier frequency=$"carrier frequency", gain=$"gain Rx", error in=w4, active antenna=$"active antenna Rx") -> (session handle out=w6, coerced carrier frequency=w7, error out=w8)
  Subtract(x=w7, y=20000) -> w9
  Property Node(instance in=w6, "LO Frequency"=w9) -> (instance out=w10)
  call "niUSRP Initiate.gvi"(session handle=w10, error in=w8) -> (session handle out=w11, error out=w12)
  call "niUSRP Fetch Rx Data (CDB).gvi"(session handle=w11, number of samples=1000000, error in=w12) -> (session handle out=w13, data=w14, error out=w15)
  call "FrameSync.gvi"(Sampled Input=w14) -> (Aligned Samples=w16)
  call "Channel Estimator.gvi"(input signal=w16) -> (signal out=w17)
  Complex To Real Imaginary(x + iy=w17) -> (x=w18)
  call "1D Convolution (DBL).gvi"(x=w18, y=w3) -> (x * y=w19)
  w20 = cluster{"t0": timestamp, "dt": f64, "Y": c128[]} {all zero or empty}
  Property Node(instance in=w20, "dt"=w1, "Y"=w19) -> (instance out=w21)
  call "FFT Power Spectrum for 1 Chan (CDB)2.gvi"(time signal=w21, dB On (F)=TRUE) -> (power spectrum=w22)
  $"Baseband output Power Spectrum" <- w22
  call "MT Generate Bits (Fibonacci, PN Order).gvi"(total bits=$"total bits") -> (output bit stream=w23)
  Multiply(2, w23) -> w24
  Subtract(x=w24, y=1) -> w25
  call "AddFrameHeader.gvi"(array=w25) -> (output array=w26)
  call "Upsample (DBL).gvi"(input array=w26, upsampling factor=w2) -> (upsampled array=w27)
  call "MT Generate Filter Coefficients.gvi"(pulse shaping filter="Root Raised Cos", pulse shaping samples per symbol=w2, modulation type="PSK") -> (pulse shaping filter coefficients=w28)
  call "1D Convolution (DBL).gvi"(x=w27, y=w28) -> (x * y=w29)
  call "Quick Scale 1D.gvi"(X=w29) -> (Y[i]=X[i]/Max|X|=w30)
  Build Waveform Node(Y=w30, dt=w1) -> (output waveform=w31)
  $"Baseband Waveform" <- w31
  w32 = cluster{"t0": timestamp, "dt": f64, "Y": c128[]} {all zero or empty}
  Property Node(instance in=w32, "dt"=w1, "Y"=w30) -> (instance out=w33)
  call "FFT Power Spectrum for 1 Chan (CDB)2.gvi"(time signal=w33, dB On (F)=TRUE) -> (power spectrum=w34)
  $"Baseband Power Spectrum" <- w34
  $"Input Bit Stream" <- w25
  Build Waveform Node(Y=w19, dt=w1) -> (output waveform=w35)
  $"Baseband Output" <- w35
  call "PulseAlign.gvi"(Input signal=w19, Receiver Sampling Factor=w2) -> (aligned output=w36)
  call "Decimate (single shot, CDB).gvi"(input array=w36) -> (decimated array=w37)
  call "FrameSync.gvi"(Sampled Input=w37) -> (Aligned Samples=w38)
  Complex To Real Imaginary(x + iy=w38) -> (x=w39)
  Is Greater Than 0(x=w39) -> w40
  Boolean To Integer(Boolean=w40) -> (0, 1=w41)
  # For Loop?
  # Advantage?
  Array Subset(array=w41, index0=0, length0=$"total bits_2") -> w42
  $"Ouput Bit Stream" <- w42
  call "niUSRP Close Session.gvi"(session handle=w13, error in=w15)
  # should be same as total bit but use control to simplif the graph
  call "MT Calculate BER After Trigger (Fibonacci PN Sequence).gvi"(input bit stream=w42, BER trigger threshold=0.4) -> (BER=w43, trigger found?=w44)
  $BER <- w43
  $"trigger found?" <- w44
  call "niUSRP Open Tx Session.gvi"(device names=$"device names") -> (session handle out=w45, error out=w46)
  call "niUSRP Configure Signal.gvi"(session handle=w45, IQ rate=$"IQ rate", carrier frequency=$"carrier frequency", gain=$"gain Tx", error in=w46, active antenna=$"active antenna Tx") -> (session handle out=w47, error out=w48)
  To Double Precision Complex(number=w30) -> w49
  call "Insert Pilots.gvi"(signal input=w49) -> (output signal=w50)
  call "AddFrameHeader (complex).gvi"(array=w50) -> (output array=w51)
  while {
    call "niUSRP Write Tx Data (CDB).gvi"(session handle=w47, data=w51, error in=w48) -> (session handle out=w52, error out=w53)
    stop if $"stop Tx"
  }
  call "niUSRP Close Session.gvi"(session handle=w52, error in=w53)
