vi "DPSK.gvi"   [LabVIEW Communications System Design Suite 2.0.1]
panel controls:
  "IQ rate": f64 = 200000
  "device names": "niUSRPClass"
  "carrier frequency": f64 = 400000000
  "gain Tx": f64
  "active antenna Tx": string = "TX1"
  "stop Tx": bool
  "gain Rx": f64
  "active antenna Rx": string = "RX2"
  "total bits": i32 = 128
  "symbol rate": f64
  "total bits_2": i32
panel indicators:
  "Baseband Waveform": waveform<f64>
  "Baseband Power Spectrum": T1
  "Baseband output Power Spectrum": T1
  "Baseband Output": waveform<c128>
  "Ouput Bit Stream": i16[]
  "BER": f64
  "trigger found?": bool
  "Input Bit Stream": f64[]
types:
  T1 = cluster{"f0": f64, "df": f64, "magnitude": f64[]}
uses:
  NI::Analysis::Operations::1D Convolution (CDB).gvi
  NI::Analysis::Resampling::Upsample (DBL).gvi
  NI::Analysis::Operations::1D Convolution (DBL).gvi
  NI::Analysis::Resampling::Decimate (single shot, CDB).gvi
diagram:
  Reciprocal(x=$"IQ rate") -> w1
  call "niUSRP Open Rx Session.gvi"(device names=$"device names") -> (error out=w2, session handle out=w3)
  call "niUSRP Configure Signal.gvi"(session handle=w3, IQ rate=$"IQ rate", carrier frequency=$"carrier frequency", gain=$"gain Rx", error in=w2, active antenna=$"active antenna Rx") -> (session handle out=w4, coerced carrier frequency=w5, error out=w6)
  Subtract(x=w5, y=20000) -> w7
  Property Node(instance in=w4, "LO Frequency"=w7) -> (instance out=w8)
  call "niUSRP Initiate.gvi"(session handle=w8, error in=w6) -> (session handle out=w9, error out=w10)
  call "niUSRP Fetch Rx Data (CDB).gvi"(session handle=w9, number of samples=1000000, error in=w10) -> (session handle out=w11, data=w12, error out=w13)
  Divide(x=$"IQ rate", y=$"symbol rate") -> w14
  call "MT Generate Filter Coefficients.gvi"(pulse shaping filter="Root Raised Cos", matched samples per symbol=w14, modulation type="PSK") -> (matched filter coefficients=w15)
  call "1D Convolution (CDB).gvi"(x=w12, y=w15) -> (x * y=w16)
  w17 = cluster{"t0": timestamp, "dt": f64, "Y": c128[]} {all zero or empty}
  Property Node(instance in=w17, "dt"=w1, "Y"=w16) -> (instance out=w18)
  call "FFT Power Spectrum for 1 Chan (CDB)2.gvi"(time signal=w18, dB On (F)=TRUE) -> (power spectrum=w19)
  $"Baseband output Power Spectrum" <- w19
  call "MT Generate Bits (Fibonacci, PN Order).gvi"(total bits=$"total bits") -> (output bit stream=w20)
  Multiply(2, w20) -> w21
  Subtract(x=w21, y=1) -> w22
  $"Input Bit Stream" <- w22
  call "AddFrameHeader.gvi"(array=w22) -> (output array=w23)
  s1 = 1  # shift register
  for {
    w24 = each element of w23
    Is Equal(x=w24, y=s1) -> w26
    Select(s=w26, t=1, f=-1) -> w27
    append w27 to w25
    next s1 = w27
  }
  call "Upsample (DBL).gvi"(input array=w25, upsampling factor=w14) -> (upsampled array=w28)
  call "MT Generate Filter Coefficients.gvi"(pulse shaping filter="Root Raised Cos", pulse shaping samples per symbol=w14, modulation type="PSK") -> (pulse shaping filter coefficients=w29)
  call "1D Convolution (DBL).gvi"(x=w28, y=w29) -> (x * y=w30)
  call "Quick Scale 1D.gvi"(X=w30) -> (Y[i]=X[i]/Max|X|=w31)
  Build Waveform Node(Y=w31, dt=w1) -> (output waveform=w32)
  $"Baseband Waveform" <- w32
  w33 = cluster{"t0": timestamp, "dt": f64, "Y": c128[]} {all zero or empty}
  Property Node(instance in=w33, "dt"=w1, "Y"=w31) -> (instance out=w34)
  call "FFT Power Spectrum for 1 Chan (CDB)2.gvi"(time signal=w34, dB On (F)=TRUE) -> (power spectrum=w35)
  $"Baseband Power Spectrum" <- w35
  Build Waveform Node(Y=w16, dt=w1) -> (output waveform=w36)
  $"Baseband Output" <- w36
  call "PulseAlign.gvi"(Input signal=w16, Receiver Sampling Factor=w14) -> (aligned output=w37)
  call "Decimate (single shot, CDB).gvi"(input array=w37, decimating factor=w14) -> (decimated array=w38)
  Array Index(array=w38) -> (out0[0]=w39)
  s2 = w39  # shift register
  for {
    w40 = each element of w38
    Complex Conjugate(x + iy=s2) -> w42
    Multiply(w40, w42) -> w43
    append w43 to w41
    next s2 = w40
  }
  call "FrameSync.gvi"(Sampled Input=w41) -> (Aligned Samples=w44)
  # For Loop?
  # Advantage?
  Complex To Real Imaginary(x + iy=w44) -> (x=w45)
  Is Greater Than 0(x=w45) -> w46
  Boolean To Integer(Boolean=w46) -> (0, 1=w47)
  Array Subset(array=w47, index0=0, length0=$"total bits_2") -> w48
  $"Ouput Bit Stream" <- w48
  call "niUSRP Close Session.gvi"(session handle=w11, error in=w13)
  # should be same as total bit but use control to simplif the graph
  call "MT Calculate BER After Trigger (Fibonacci PN Sequence).gvi"(input bit stream=w48, BER trigger threshold=0.4) -> (BER=w49, trigger found?=w50)
  $BER <- w49
  $"trigger found?" <- w50
  call "niUSRP Open Tx Session.gvi"(device names=$"device names") -> (session handle out=w51, error out=w52)
  call "niUSRP Configure Signal.gvi"(session handle=w51, IQ rate=$"IQ rate", carrier frequency=$"carrier frequency", gain=$"gain Tx", error in=w52, active antenna=$"active antenna Tx") -> (session handle out=w53, error out=w54)
  To Double Precision Complex(number=w31) -> w55
  while {
    call "niUSRP Write Tx Data (CDB).gvi"(session handle=w53, data=w55, error in=w54) -> (session handle out=w56, error out=w57)
    stop if $"stop Tx"
  }
  call "niUSRP Close Session.gvi"(session handle=w56, error in=w57)
